# Grasshopper definition 3d_isovist_sampling DRAWING.gh (Grasshopper 1.0.8)

pt = Point(<point referenced from the Rhino model>)

# ----
# Set Curves
crv = Curve([<curve referenced from the Rhino model> x101])

series = Series(Start="0", Step="1", Count=Slider(10, range=0..10, expression="x*10"))

# ----
# Start
toggle = BooleanToggle(False)

item = ListItem(List=crv, Index=series, Wrap=True)
brep = Brep(<brep referenced from the Rhino model>)
py3 = Python3Script(Pts=pt)  # -> out, a
# ---------- py3: Python ----------
import Rhino.Geometry as rg
import scriptcontext as sc
import math

RayCount = 2048
MaxDist = 10.0

Start = True

if Start:
    # Fibonacci Sphere for Ray Directions
    def sphere_directions(n):
        dirs = []
        offset = 2.0 / n
        inc = math.pi * (3.0 - math.sqrt(5.0))
        for i in range(n):
            y = ((i * offset) - 1) + (offset / 2)
            r = math.sqrt(max(0.0, 1 - y * y))
            phi = i * inc
            x = math.cos(phi) * r
            z = math.sin(phi) * r
            dirs.append(rg.Vector3d(x, z, y))
        return dirs
    
    # Extract actual point from GUID
    rh_obj = sc.doc.Objects.Find(Pts)
    if rh_obj and hasattr(rh_obj.Geometry, "Location"):
        obs_pt = rh_obj.Geometry.Location
    else:
        obs_pt = Pts  # fallback if already Point3d
    
    # Generate directions
    directions = sphere_directions(RayCount)
    
    # Create points at max radius
    result_points = []
    for d in directions:
        d.Unitize()
        pt = obs_pt + (d * MaxDist)
        result_points.append(pt)
    
    a = result_points
    print("Generated {} direction points".format(len(result_points)))

else:
    a = []
# ---------- end py3 ----------
py3_2 = Python3Script(Geo=brep, Pts=pt)  # -> out, a
# ---------- py3_2: Python ----------
import Rhino.Geometry as rg
import scriptcontext as sc
import math

RayCount = 2048
MaxDist = 10.0

Start = True

if Start:
    # Fibonacci Sphere for Ray Directions
    def sphere_directions(n):
        dirs = []
        offset = 2.0 / n
        inc = math.pi * (3.0 - math.sqrt(5.0))
        for i in range(n):
            y = ((i * offset) - 1) + (offset / 2)
            r = math.sqrt(max(0.0, 1 - y * y))
            phi = i * inc
            x = math.cos(phi) * r
            z = math.sin(phi) * r
            dirs.append(rg.Vector3d(x, z, y))
        return dirs
    
    # Extract observation point
    rh_obj = sc.doc.Objects.Find(Pts)
    if rh_obj and hasattr(rh_obj.Geometry, "Location"):
        obs_pt = rh_obj.Geometry.Location
    else:
        obs_pt = Pts
    
    # Process geometry into meshes
    Geo_list = list(Geo) if isinstance(Geo, (list, tuple)) else [Geo]
    meshes = []
    for ref in Geo_list:
        rh_obj = sc.doc.Objects.Find(ref)
        if rh_obj:
            geom = rh_obj.Geometry
            if isinstance(geom, rg.Brep):
                mesh_array = rg.Mesh.CreateFromBrep(geom, rg.MeshingParameters.Default)
                if mesh_array:
                    for m in mesh_array:
                        meshes.append(m)
            elif isinstance(geom, rg.Mesh):
                meshes.append(geom)
    
    # Generate directions
    directions = sphere_directions(RayCount)
    
    # Cast rays and collect intersection points
    isovist_points = []
    eps = 1e-6
    
    for d in directions:
        d.Unitize()
        ray = rg.Ray3d(obs_pt, d)
        
        # Find closest hit
        closest_dist = MaxDist
        for mesh in meshes:
            t = rg.Intersect.Intersection.MeshRay(mesh, ray)
            if t >= eps and t < closest_dist:
                closest_dist = t
        
        # Create point at intersection distance
        hit_pt = obs_pt + (d * closest_dist)
        isovist_points.append(hit_pt)
    
    a = isovist_points
    print("Generated {} isovist intersection points".format(len(isovist_points)))

else:
    a = []
# ---------- end py3_2 ----------

# ----
# Set Building Brep
brep_2 = Brep(<brep referenced from the Rhino model>)

divlength = DivideLength(Curve=item, Length="0.5")  # -> Points, Tangents, Parameters
panel = Panel(py3.out)
pt_2 = Point([<point referenced from the Rhino model> x2048])
isovist_sampling = Python3Script(Start=toggle, Pts=divlength.Points, Geo=brep_2)  # -> out, a, b; inputs Pts: tree
# ---------- isovist_sampling: Python ----------
import Rhino.Geometry as rg
import Rhino
import scriptcontext as sc
import math
import System.IO as IO
import System
import System.Threading.Tasks as tasks

SaveFolder = r"C:\Users\shrua\OneDrive\Desktop\threshold project\threshold\data\raw\t7-4"
RayCount = 2048
MaxDist = 10.0

if Start:

    # Fibonacci Sphere for Ray Directions (map vertical -> Rhino Z)
    def sphere_directions(n):
        dirs = []
        offset = 2.0 / n
        inc = math.pi * (3.0 - math.sqrt(5.0))
        for i in range(n):
            y = ((i * offset) - 1) + (offset / 2)   # vertical in the sphere frame
            r = math.sqrt(max(0.0, 1 - y * y))
            phi = i * inc
            x = math.cos(phi) * r
            z = math.sin(phi) * r
            # Rhino is Z-up, so put the "vertical" y into Z:
            dirs.append(rg.Vector3d(x, z, y))
        return dirs

    # Preprocess Geometry
    Geo = list(Geo) if isinstance(Geo, (list, tuple)) else [Geo]
    meshes = []
    for ref in Geo:
        rh_obj = sc.doc.Objects.Find(ref)
        if rh_obj:
            geom = rh_obj.Geometry
            if isinstance(geom, rg.Brep):
                mesh_array = rg.Mesh.CreateFromBrep(geom, rg.MeshingParameters.Default)
                if mesh_array:
                    for m in mesh_array:
                        m.RebuildNormals()
                        meshes.append(m)
            elif isinstance(geom, rg.Mesh):
                geom.RebuildNormals()
                meshes.append(geom)

    # NEW: mesh the Ground Brep (separate from other meshes)
    ground_mesh = None
    if Ground is not None:
        if isinstance(Ground, rg.Brep):
            gm_arr = rg.Mesh.CreateFromBrep(Ground, rg.MeshingParameters.Default)
            if gm_arr and len(gm_arr) > 0:
                ground_mesh = rg.Mesh()
                for gm in gm_arr:
                    ground_mesh.Append(gm)
                ground_mesh.Normals.ComputeNormals()
                ground_mesh.Compact()
        elif isinstance(Ground, rg.Mesh):
            ground_mesh = Ground
            ground_mesh.RebuildNormals()

    meshes_wo_ground = [m for m in meshes if m is not ground_mesh]

    # Generate directions and unitize
    dirs = sphere_directions(RayCount)
    for d in dirs:
        d.Unitize()

    RayLines = []
    ExportedFiles = []

    # Handle multiple branches of points
    for i, branch in enumerate(Pts.Branches):

        # Convert branch points to Point3d
        real_pts = []
        for ref in branch:
            rh_obj = sc.doc.Objects.Find(ref)
            if rh_obj and hasattr(rh_obj.Geometry, "Location"):
                real_pts.append(rh_obj.Geometry.Location)
            elif isinstance(ref, rg.Point3d):
                real_pts.append(ref)

        Isovists = [None] * len(real_pts)
        eps = 1e-6  # ignore self-hits for non-ground meshes

        # Define function for a single point
        def compute_isovist(idx):
            pt = real_pts[idx]
            dists = []
            for dir in dirs:
                ray = rg.Ray3d(pt, dir)

                # Closest hit among non-ground meshes
                dist_any = MaxDist
                for mesh in meshes_wo_ground:
                    t = rg.Intersect.Intersection.MeshRay(mesh, ray)
                    if t >= eps and t < dist_any:
                        dist_any = t

                # Hit on ground mesh (accept t == 0 as valid ground hit)
                t_ground = System.Double.PositiveInfinity
                if ground_mesh is not None:
                    tg = rg.Intersect.Intersection.MeshRay(ground_mesh, ray)
                    if tg >= 0.0:
                        t_ground = tg

                # If ground is the first hit within range, record 0
                if t_ground < dist_any and t_ground <= MaxDist:
                    dist = 0.0
                else:
                    dist = dist_any

                dists.append(dist)
                RayLines.append(rg.Line(pt, dir * (dist if dist > 0 else 0.0)))

            Isovists[idx] = dists

        # Parallel processing of points
        tasks.Parallel.For(0, len(real_pts), compute_isovist)

        # Save CSV
        if not IO.Directory.Exists(SaveFolder):
            IO.Directory.CreateDirectory(SaveFolder)

        filename = "curve_{:02d}.csv".format(i)
        filepath = IO.Path.Combine(SaveFolder, filename)
        writer = IO.StreamWriter(filepath)

        # Transpose: rows = rays, columns = points
        transposed = zip(*Isovists)
        for ray_row in transposed:
            line = ",".join([str(round(d, 4)) for d in ray_row])
            writer.WriteLine(line)
        writer.Close()

        ExportedFiles.append(filename)
        print("Saved:", filename, "with", len(Isovists), "samples →", filepath)

    # Outputs
    a = ExportedFiles
    b = RayLines

else:
    print("not started")
    a = []
    b = []
# ---------- end isovist_sampling ----------
cir = Circle(Plane=pt_2, Radius=Slider(0.05, range=0..0.1))
# Trigger
# Trigger
panel_2 = Panel(isovist_sampling.a)
