# Grasshopper definition simulate_path_building_new.gh (Grasshopper 1.0.8)
# plug-ins: PedSimulation

# ----
# generate random start points
panel = Panel("1001")
crv = Curve(<curve referenced from the Rhino model>)
random = Random(Range=Domain(0, 1), Number="10", Seed=panel)
eval = EvaluateCurve(Curve=reparameterize(crv), Parameter=random)  # -> Point, Tangent, Angle

# ----
# generate random end points
panel_2 = Panel("1001")
crv_2 = Curve(<curve referenced from the Rhino model>)
random_2 = Random(Range=Domain(0, 1), Number="10", Seed=panel_2)
eval_2 = EvaluateCurve(Curve=reparameterize(crv_2), Parameter=random_2)  # -> Point, Tangent, Angle

pill_tag = BooleanToggle(False)
pill_tag_2 = BooleanToggle(False)
gate = Gate(
    Position=eval.Point,
    GateName="start",
    ExitTime=Slider(0, range=0..1),
    AccessRadius=Slider(0, range=0..1),
    DrawDot=pill_tag,
    Color=ColourSwatch(SwatchColor=RGB(255, 0, 0)))
gate_2 = Gate(
    Position=eval_2.Point,
    GateName="end",
    ExitTime=Slider(0, range=0..1),
    AccessRadius=Slider(0, range=0..1),
    DrawDot=pill_tag_2,
    Color=ColourSwatch(SwatchColor=RGB(38, 117, 252)))
program = ProgramComponent(ProgramName="interest", DisplayColor=ColourSwatch(SwatchColor=RGB(0, 51, 255)))
crossref = CrossReference(ListA=gate, ListB=gate_2, CrossMode=1)  # -> ListA, ListB
body_width = Slider(0.3, range=0.3..0.95)
pt = Point([Point(-16.91956181, -45.91565034, 0), Point(-5.041439332, -46.58963682, 0), Point(-3.322130855, -54.79019699, 0), Point(-8.496228077, -58.80364688, 0), Point(-8.614773283, -63.24914454, 0), Point(-3.788008609, -65.8290505, 0), Point(-10.45503256, -68.91312715, 0)])
body_width_2 = Slider(0.3, range=0.3..0.95)
pt_2 = Point([Point(-10.17826798, -37.37566256, 0), Point(-3.896064641, -36.22257711, 0), Point(0.9161897876, -39.47059708, 0), Point(0.8520017171, -46.75946477, 0), Point(-3.3779303, -48.28749297, 0), Point(-3.72286416, -50.60352794, 0), Point(-3.346101412, -52.82592095, 0), Point(-4.75243726, -55.29152186, 0), Point(-9.308018968, -57.79651985, 0), Point(-8.915957753, -60.98769366, 0), Point(-7.52530169, -63.35300424, 0), Point(-3.425914492, -65.88657876, 0), Point(-3.865579145, -69.46630499, 0), Point(-11.64645681, -65.87427937, 0), Point(-14.84623764, -68.36807321, 0), Point(-12.856862, -70.69608502, 0)])
pill_tag_3 = BooleanToggle(True)
fanvision = FanShapedVision(Angle=Slider(150, range=0..1000), Distance=Slider(15, range=0..100))
spawn_time = Slider(52, range=1..100, expression="x/4")
target = Target(
    Position=pt_2,
    Program=program,
    VisitingTime=Slider(0, range=0..500),
    AccessRadius=body_width_2,
    DrawDot=pill_tag_3,
    createMultipleTargets=True)
pt_3 = PersonTemplate(
    StartGate=crossref.ListA,
    DestinationGate=crossref.ListB,
    Interests=program,
    NeedValue=Slider(5, range=0..10),
    StartNumber=0,
    Probability=Slider(3.3, range=0..10),
    TimeLimit=-1,
    Vision=fanvision,
    BodyRadius=expr("x/2", body_width),
    TargetForce=20,
    DisplayColor=ColourSwatch(SwatchColor=RGB(5, 235, 89)),
    PersonTemplateDirectionMode=1)
crv_3 = Curve([<curve referenced from the Rhino model> x2])

# ----
# Trigger
timer = Timer(Interval=10, TimerInterval=10, Target=pedsim)  # disabled

settings = SystemSettings(
    FPS=30,
    ObstacleOffset=1,
    ObstacleRepulsionCoefA=50,
    ObstacleRepulsionCoefB=2,
    ObstacleRepulsionMax=5,
    ObstacleRepulsionThreshold=0.5,
    EnableTrace=Toggle(True))
pedsim = PedSimulationSystem(
    Reset=Button(),
    PersonTemplates=pt_3,
    ObstacleCurves=crv_3,
    Population=Slider(3, range=1..10, expression="x*10"),
    Targets=target,
    GenerationTime=spawn_time,
    SystemSettings=settings)  # -> Out, People, GraphEdges, GraphVertices, GoalTagPositions, VisitCounts, PersonRecords
deconspr = DeconstructPersonRecord(PersonRecord=pedsim.PersonRecords)  # -> PersonID, TemplateID, StartTime, EndTime, TimeSequence, TracePositions, TraceSpeeds, StateSequence
pline = PolyLine(Vertices=deconspr.TracePositions, Closed=False)
deconsp = DeconstructPerson(Person=pedsim.People)  # -> ID, TemplateID, Position, BodyRadius, Velocity, Acceleration, CurrentPath, Behaviors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

# ----
# Preview Sightline
drawperson = DrawPerson(People=pedsim.People, drawCurrentTargetFill=True, drawFOV=True, drawNumber=True)

# ----
# Preview Points/Paths
pt_4 = Point(deconsp.Position)
crv_4 = Curve(deconsp.CurrentPath)
