# Grasshopper definition simulate_path_building_soane.gh (Grasshopper 1.0.8)
# plug-ins: PedSimulation

# ----
# generate random start points
panel = Panel("1001")
crv = Curve(<curve referenced from the Rhino model>)
random = Random(Range=Domain(0, 1), Number="10", Seed=panel)
eval = EvaluateCurve(Curve=reparameterize(crv), Parameter=random)  # -> Point, Tangent, Angle

# ----
# generate random end points
panel_2 = Panel("1001")
crv_2 = Curve(<curve referenced from the Rhino model>)
random_2 = Random(Range=Domain(0, 1), Number="10", Seed=panel_2)
eval_2 = EvaluateCurve(Curve=reparameterize(crv_2), Parameter=random_2)  # -> Point, Tangent, Angle

pill_tag = BooleanToggle(False)
pill_tag_2 = BooleanToggle(False)
pt = Point([Point(-0.0817310618, -4.405191415, 0), Point(0.1638399577, -4.267838133, 0), Point(0.2637332538, -4.37189365, 0), Point(0.4676820667, -4.326109222, 0), Point(0.5342775974, -4.209567043, 0), Point(0.7798486169, -4.292811457, 0)])
pt_2 = Point([Point(-9.051749238, 13.58960929, 0), Point(-9.069943313, 14.37195449, 0), Point(-8.433150704, 13.98987893, 0), Point(-8.487732928, 15.19068785, 0), Point(-9.470212952, 15.55456934, 0), Point(-8.178433661, 15.84567453, 0)])
gate = Gate(
    Position=pt,
    GateName="start",
    ExitTime=Slider(0, range=0..1),
    AccessRadius=Slider(0, range=0..1),
    DrawDot=pill_tag,
    Color=ColourSwatch(SwatchColor=RGB(255, 0, 0)))
gate_2 = Gate(
    Position=pt_2,
    GateName="end",
    ExitTime=Slider(0, range=0..1),
    AccessRadius=Slider(0, range=0..1),
    DrawDot=pill_tag_2,
    Color=ColourSwatch(SwatchColor=RGB(38, 117, 252)))
program = ProgramComponent(ProgramName="interest", DisplayColor=ColourSwatch(SwatchColor=RGB(0, 51, 255)))
crossref = CrossReference(ListA=gate, ListB=gate_2, CrossMode=1)  # -> ListA, ListB
body_width = Slider(0.3, range=0.3..0.95)
body_width_2 = Slider(0.3, range=0.3..0.95)
pill_tag_3 = BooleanToggle(True)
pt_3 = Point([Point(0.2669668936, -2.602291059, 0), Point(0.6361272526, 0.1743330505, 0), Point(0.2465759081, 2.49168189, 0), Point(1.57473642, 2.796191381, 0), Point(4.666120421, 2.499530357, 0), Point(5.522138515, 4.071551417, 0), Point(4.340476179, 6.396004989, 0), Point(4.667038865, 9.944725121, 0), Point(7.193521071, 10.58340324, 0), Point(9.508413973, 10.41155113, 0), Point(11.71302294, 9.163220705, 0), Point(14.63692193, 7.819786155, 0), Point(14.85161338, 5.180176943, 0), Point(14.70376271, 2.092289164, 0)])
pt_4 = Point([Point(-0.2419068343, 0.3204415707, 0), Point(0.3079243825, 1.615827914, 0), Point(-0.874171637, 4.975812135, 0), Point(-0.597081466, 7.199208293, 0), Point(-0.3077579576, 9.510397227, 0), Point(-0.7617882357, 12.37500253, 0), Point(-2.000832379, 12.40740593, 0), Point(-3.649642554, 11.84764914, 0), Point(-4.301559034, 12.73853752, 0), Point(-4.528406931, 14.83466231, 0), Point(-6.148444826, 15.58855607, 0), Point(-7.533678077, 14.53828013, 0)])
fanvision = FanShapedVision(Angle=Slider(150, range=0..1000), Distance=Slider(15, range=0..100))
spawn_time = Slider(26, range=1..100, expression="x/4")
target = Target(
    Position=pt_4,
    Program=program,
    VisitingTime=Slider(0, range=0..500),
    AccessRadius=body_width_2,
    DrawDot=pill_tag_3,
    createMultipleTargets=True)
pt_5 = PersonTemplate(
    StartGate=crossref.ListA,
    DestinationGate=crossref.ListB,
    Interests=program,
    NeedValue=Slider(8, range=0..10),
    StartNumber=0,
    Probability=Slider(3.3, range=0..10),
    TimeLimit=-1,
    Vision=fanvision,
    BodyRadius=expr("x/2", body_width),
    TargetForce=20,
    DisplayColor=ColourSwatch(SwatchColor=RGB(5, 235, 89)),
    PersonTemplateDirectionMode=1)
crv_3 = Curve([<curve referenced from the Rhino model> x48])

# ----
# Trigger
timer = Timer(Interval=10, TimerInterval=10, Target=pedsim)  # disabled

settings = SystemSettings(
    FPS=30,
    ObstacleOffset=1,
    ObstacleRepulsionCoefA=50,
    ObstacleRepulsionCoefB=2,
    ObstacleRepulsionMax=5,
    ObstacleRepulsionThreshold=0.5,
    EnableTrace=Toggle(True))
pedsim = PedSimulationSystem(
    Reset=Button(),
    PersonTemplates=pt_5,
    ObstacleCurves=crv_3,
    Population=Slider(3, range=1..10, expression="x*10"),
    Targets=target,
    GenerationTime=spawn_time,
    SystemSettings=settings)  # -> Out, People, GraphEdges, GraphVertices, GoalTagPositions, VisitCounts, PersonRecords
deconspr = DeconstructPersonRecord(PersonRecord=pedsim.PersonRecords)  # -> PersonID, TemplateID, StartTime, EndTime, TimeSequence, TracePositions, TraceSpeeds, StateSequence
pline = PolyLine(Vertices=deconspr.TracePositions, Closed=False)
deconsp = DeconstructPerson(Person=pedsim.People)  # -> ID, TemplateID, Position, BodyRadius, Velocity, Acceleration, CurrentPath, Behaviors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

# ----
# Preview Sightline
drawperson = DrawPerson(People=pedsim.People, drawCurrentTargetFill=True, drawFOV=True, drawNumber=True)

# ----
# Preview Points/Paths
pt_6 = Point(deconsp.Position)
crv_4 = Curve(deconsp.CurrentPath)
